# Grasshopper definition sDNA_build_components.gh (Grasshopper 1.0.7)

# Leave Go to True to use batch file component builder.
# Edit this file with Disable Solver set.
path = FilePath("C:\Users\James\Documents\Rhino\Grasshopper\sDNA\source\repos\GHsDNAv0.01\sDNA_GH\launcher.py")
panel = Panel("""#! /usr/bin/awk NR==3
# -*- coding: utf-8 -*-
# This module requires Grasshopper Python (Rhino3D)

# MIT License

# Copyright (c) [2021] [Cardiff University, a body incorporated
# by Royal Charter and a registered charity (number:
# 1136855) whose administrative offices are at 7th floor 30-
# 36 Newport Road, University CF24 0DE, Wales, UK]

# Permission is hereby granted, free of charge, to any person obtaining a copy
# of this software and associated documentation files (the "Software"), to deal
# in the Software without restriction, including without limitation the rights
# to use, copy, modify, merge, publish, distribute, sublicense, and/or sell
# copies of the Software, and to permit persons to whom the Software is
# furnished to do so, subject to the following conditions:

# The above copyright notice and this permission notice shall be included in all
# copies or substantial portions of the Software.

# THE SOFTWARE IS PROVIDED "AS IS", WITHOUT WARRANTY OF ANY KIND, EXPRESS OR
# IMPLIED, INCLUDING BUT NOT LIMITED TO THE WARRANTIES OF MERCHANTABILITY,
# FITNESS FOR A PARTICULAR PURPOSE AND NONINFRINGEMENT. IN NO EVENT SHALL THE
# AUTHORS OR COPYRIGHT HOLDERS BE LIABLE FOR ANY CLAIM, DAMAGES OR OTHER
# LIABILITY, WHETHER IN AN ACTION OF CONTRACT, TORT OR OTHERWISE, ARISING FROM,
# OUT OF OR IN CONNECTION WITH THE SOFTWARE OR THE USE OR OTHER DEALINGS IN THE
# SOFTWARE.



\"\"\" Main entry point to launch sDNA_GH if run as a script from an sDNA_GH GhPython component.

    Imports the python package sDNA_GH and (re)defining the MyComponent(component) 
    class.  Grasshopper instantiates this class in each such component, then 
    calls its RunScript method 
    (and recalls it on each Param update / recalculation).

    There may be multiple components, all running this same launcher code.
    Therefore we want the root logger to live in the sDNA_GH.main module
    that they each import.  The logging system is configurable by the user,
    but only through the options that are read in during the main package
    import, and we want to create logs before this too, in this module.  So 
    before a component has imported sDNA_GH.main, logging is routed through output, 
    a callable instance of Output, with a cache, defined below.  After a logger has 
    been set up according to the user's configuration, after the main package import,
    output's cache is flushed through the normal logging system, 

    Also, the Output class is used to define two Classes from this single 
    code definition.  Python scripts can happily import themselves, but here
    this is because launcher.py is itself part of the imported sDNA_GH python
    package, imported by launcher.py in a GhPythoncomponent.  To achieve this, the 
    code in this file needs to be copied into the sDNA_GH GhPython components 
    during building of the components (e.g. via the code input Param), 

    The behaviours can be different of course if changes are made to one and not
    the other. e.g. if updated code is forgotten to be copied into the component.

    A dummy MyComponent(component) class is defined in the script to appease
    GhPython's parser, even though the definition we use is imported from the package

    launcher.py can also run unittests in a component named "selftest" 
\"\"\"

__author__ = 'James Parrott'
__version__ = '0.04'



import sys
import os
import functools
import importlib

from ghpythonlib.componentbase import executingcomponent as component
import Grasshopper
import scriptcontext as sc

import_module = importlib.import_module
try:
    reload #type: ignore
except NameError:
    reload = importlib.reload

try:
    basestring #type: ignore
except NameError:
    basestring = str

try:
    ghdoc #type: ignore
except NameError:
    from .custom.skel.basic.ghdoc import ghdoc

package_name = 'sDNA_GH'
plug_in_name = 'sDNA'               
reload_already_imported = False
repo_folder = os.path.dirname( os.path.dirname(ghdoc.Path) ) if ghdoc.Path else None
user_install_folder = Grasshopper.Folders.DefaultUserObjectFolder




class Output(object): 

    def set_logger(self, logger, flush = True):
        self.logger = logger
        if flush and self.tmp_logs:
            self.flush()

    def __init__(self
                ,tmp_logs = None
                ,logger = None
                ):
        if not isinstance(tmp_logs, list): #assert not isinstance(None, list)
            tmp_logs = []
        self.tmp_logs = tmp_logs
        self.set_logger(logger, flush = False)



    def store(self, message, logging_level):
        self.tmp_logs.append( (message, logging_level) )

    def __call__(self, message, logging_level = "INFO", logging_dict = {}):
        #type: (str, str, dict, list) -> str
        
        #logger.debug(s)

        if logging_dict == {} and self.logger is not None: 
            logging_dict = dict( DEBUG = self.logger.debug
                                ,INFO = self.logger.info
                                ,WARNING = self.logger.warning
                                ,ERROR = self.logger.error
                                ,CRITICAL = self.logger.critical
                                )

        logging_level = logging_level.upper()
        if logging_level in logging_dict:
            logging_dict[logging_level](message)
        else:
            self.store(message, logging_level)

        return '%s : %s ' % (logging_level, message)

    def __getattr__(self, attr):
        return functools.partial(self.__call__, logging_level = attr.upper())

    def flush(self):
        tmp_logs = self.tmp_logs[:] # __call__ might cache back to tmp_logs
        self.tmp_logs[:] = [] # Mutate list initialised with.  Avoid double 
                              # logging in case re - stored in tmp_logs
        for tmp_log_message, tmp_log_level in tmp_logs:
            self.__call__(tmp_log_message, tmp_log_level)

output = Output()


class InvalidArgsError(Exception):
    
    \"\"\"Custom exception to log the error message, and to at least allow 
       attempts to give users actionable advice to fix the issue, in 
       the event of a problem.  
    \"\"\"
    message_fmt = 'Invalid import args: %s'
    def __init__(self
                ,message_fmt = ''
                ,message = ''
                ,logger = output
                , **kwargs
                ):
        if message_fmt and isinstance(message_fmt, basestring):
            self.message_fmt = message_fmt
        if not message or not isinstance(message, basestring):
            message = self.message_fmt % kwargs
        logger.error(message)
        self.kwargs = kwargs
        super(Exception, self).__init__(message)    


class ModuleNameError(InvalidArgsError):
    message_fmt = 'Invalid module name: %s'


class FilePathError(InvalidArgsError):
    message_fmt = 'Invalid path to import module from: %s'


# We only know the sDNA version to import as a string.  This is more secure too.
def strict_import(module_name = ''
                 ,folder = ''
                 ,sub_folder = ''
                 ,logger = output
                 ,reload_already_imported = reload_already_imported
                 ):

    # type: (str, str, str, type[any], bool) -> type[any]
    \"\"\" Imports the named module from the specified folder\subfolder only, 
        and returns it.
        
        Avoids name clashes and casual hijack attempts.  In some 
        environments supporting a Python implementation (such as 
        GhPython in Grasshopper) it may not be desireable to ask the user 
        to set PYTHONPATH.  Hence here, we save sys.path to a tmp 
        variable, set sys.path to the specified folders, attempt the 
        import in a try: block, and restore sys.path in a finally: block
    \"\"\"
    if not module_name or not isinstance(module_name, basestring):
        raise ModuleNameError(module_name = module_name
                             ,folder = folder
                             ,sub_folder = sub_folder
                             ,logger = logger
                             )
    logger.debug(module_name)
    if module_name in sys.modules:   # sys.modules is also shared between GHPython components 
                                     # (and is even saved until Rhino is closed).
        logger.debug('Module %s already in sys.modules' % module_name)
        if reload_already_imported:
            logger.debug('Reloading %s.... ' % module_name)
            reload(sys.modules[module_name]) # type: ignore
        return sys.modules[module_name]
    #
    #
    # Load module_name for first time:
    #
    #
    search_path = os.path.join(folder, sub_folder)

    if (search_path 
        and isinstance(search_path, basestring) 
        and os.path.isdir(search_path)):
        #
        logger.debug('Search path == %s' % search_path)
        #if search_folder_only:
        #    sys.path = [search_path]
        if search_path not in sys.path:
            sys.path.insert(0, search_path)
    else:
        raise FilePathError(module_name = module_name
                           ,search_path = search_path
                           ,logger = logger
                           )

    logger.debug('Trying import... ')
    module = import_module(module_name, '')           

    return module       


class ModulesNotFoundError(InvalidArgsError):
    message_fmt = 'Modules not found in any location %s'


def load_modules(m_names
                ,folders
                ,logger = output
                ,module_name_error_msg = 'Please supply valid names of modules to import, %s'
                ,folders_error_msg = 'Please supply valid folders to import from. %s'
                ,modules_not_found_msg = 'Specified modules not found in any folder, %s'):
    #type(str/ Iterable, list, type[any], str, str) -> tuple / None
    \"\"\" Tries to import all modules in m_names, from the first folder in 
        folders to contain a .py or .pyc files with the same name as each 
        module.

        Returns a tuple of all the modules and the path they were found in.  Else 
        raises a ModulesNotFoundError.
    \"\"\"
    if not m_names or any( not isinstance(m_name, basestring) 
                               for m_name in m_names ):
        raise ModuleNameError(message_fmt = module_name_error_msg
                             ,m_names = m_names
                             ,logger = logger
                             )
    
    if isinstance(m_names, basestring):
        m_names = [m_names] 
    logger.debug('m_names == %s of type : %s' % (m_names, type(m_names).__name__))

    logger.debug('Testing paths : %s ' % folders)
    
    if isinstance(folders, basestring):
        folders = [folders]

    if not any(os.path.isdir(folder) or os.path.isdir(os.path.dirname(folder)) 
               for folder in folders
              ):
        raise FilePathError(message_fmt = folders_error_msg
                           ,m_names = m_names
                           ,logger = logger
                           )

    for folder in folders:
        logger.debug('Type(folder) : %s' % type(folder).__name__)
        logger.debug('Type(path) : %s path == %s' %(type(folder).__name__, folder))

        if os.path.isfile(folder):
            folder = os.path.dirname(folder)
        if all( any(os.path.isfile(os.path.join(folder, name.replace('.', os.sep) + ending)) 
                    for ending in ['.py','.pyc'] 
                   )
                for name in m_names
              ):
            #
            logger.debug('Importing %s' % repr(m_names))

            return tuple(strict_import(name, folder, '', logger = logger) 
                            for name in m_names
                        ) + (folder,)
            # tuple of modules, followed by the path to them
    raise ModulesNotFoundError(message_fmt = modules_not_found_msg
                              ,m_names = m_names
                              ,folders = folders
                              ,logger = logger
                              )




if __name__ == '__main__': # False in a compiled component.  But then the user
                           # can't add or remove Params to the component.  
    
    # Grasshopper will look for class MyComponent(component) in global scope
    # so a main function is a little tricky to define.

    nick_name = ghenv.Component.NickName #type: ignore

    if (repo_folder and 
        nick_name.replace(' ','').replace('_','').lower() == 'buildcomponents'):
        #
        sDNA_GH_search_paths = repo_folder 
        # builder can only load sDNA_GH from its parent directory, 
        # e.g. if in a dir one level up in the main repo
        # such as sDNA_build_components.gh.
    else:
        sDNA_GH_search_paths = user_install_folder


    sc.doc = ghdoc #type: ignore

    output.debug(sDNA_GH_search_paths)

    class sDNA_GH(object):
        pass

    if 'sDNA_GH.main' in sys.modules:
        sDNA_GH.main = sys.modules['sDNA_GH.main']
    else:
        sDNA_GH.main, _ = load_modules(m_names = package_name + '.main'
                                      ,folders = sDNA_GH_search_paths
                                      ,folders_error_msg = 'Please ensure a folder called %s' % package_name 
                                                          +' is created in '
                                                          +Grasshopper.Folders.DefaultUserObjectFolder                                                                    
                                                          +', containing main.py and all sDNA_GH python' 
                                                          +' files and subfolders. ' 
                                      ,modules_not_found_msg = 'Some sDNA_GH files may be missing.  Please copy'
                                                              +' sDNA_GH.zip into: '
                                                              +Grasshopper.Folders.DefaultUserObjectFolder
                                                              +', Unblock it if necessary, and then right click'
                                                              +' it and select Extract All... in that location. '
                                                              +' Ensure that main.py and all sDNA_GH python' 
                                                              +' files and subfolders are inside: '
                                                              +os.path.join(Grasshopper.Folders.DefaultUserObjectFolder
                                                                           ,package_name
                                                                           )
                                      )         


    logger = sDNA_GH.main.logger.getChild('launcher')
    output.set_logger(logger, flush = True)


    class MyComponent(component):
        pass  # Required.  Idiomatic to Grasshopper.  Must be called "MyComponent"  
            # too (it is looked for by the parser or scope checker?) otherwise 
            # Grasshopper may not find the subclass of on 
            # component.  Even though we overwrite this class on the next line
            # immediately below.  

    MyComponent = sDNA_GH.main.sDNA_GH_Component


    if nick_name.replace(' ','').replace('_','').lower() == 'selftest':  

        if sys.argv[0].endswith(os.path.join(package_name,'__main__.py')):   
            from .tests.unit_tests import unit_tests_sDNA_GH
        else:
            unit_tests_sDNA_GH, _ = load_modules('sDNA_GH.tests.unit_tests.unit_tests_sDNA_GH'
                                                ,sDNA_GH_search_paths
                                                )

        MyComponent._RunScript = MyComponent.RunScript
        MyComponent.RunScript = unit_tests_sDNA_GH.run_launcher_tests  """)
# .shp
# Analysis
# Calibration
# Data
# Dev
# Extra
# Geom
# Plot
# Preparation
sdna_gh = Text("sDNA_GH")
file = ReadFile(File=path, PerLineParse=False)
build_components = GhPythonScript(go=Toggle(True))  # -> out, OK, opts; inputs go: list, opts: list
#   port go: true: runs tools. false: do not run tools but still read other Params.
#   port opts: sDNA_GH options data structure. Python dictionary.
#   port OK: true: tools ran successfully. false: tools did not run, or there was an error.
#   port opts: sDNA_GH options data structure. Python dictionary.
# ---------- build_components: Python ----------
#! /usr/bin/awk NR==3
# -*- coding: utf-8 -*-
# This module requires Grasshopper Python (Rhino3D)

# MIT License

# Copyright (c) [2021] [Cardiff University, a body incorporated
# by Royal Charter and a registered charity (number:
# 1136855) whose administrative offices are at 7th floor 30-
# 36 Newport Road, University CF24 0DE, Wales, UK]

# Permission is hereby granted, free of charge, to any person obtaining a copy
# of this software and associated documentation files (the "Software"), to deal
# in the Software without restriction, including without limitation the rights
# to use, copy, modify, merge, publish, distribute, sublicense, and/or sell
# copies of the Software, and to permit persons to whom the Software is
# furnished to do so, subject to the following conditions:

# The above copyright notice and this permission notice shall be included in all
# copies or substantial portions of the Software.

# THE SOFTWARE IS PROVIDED "AS IS", WITHOUT WARRANTY OF ANY KIND, EXPRESS OR
# IMPLIED, INCLUDING BUT NOT LIMITED TO THE WARRANTIES OF MERCHANTABILITY,
# FITNESS FOR A PARTICULAR PURPOSE AND NONINFRINGEMENT. IN NO EVENT SHALL THE
# AUTHORS OR COPYRIGHT HOLDERS BE LIABLE FOR ANY CLAIM, DAMAGES OR OTHER
# LIABILITY, WHETHER IN AN ACTION OF CONTRACT, TORT OR OTHERWISE, ARISING FROM,
# OUT OF OR IN CONNECTION WITH THE SOFTWARE OR THE USE OR OTHER DEALINGS IN THE
# SOFTWARE.



""" Main entry point to launch sDNA_GH if run as a script from an sDNA_GH GhPython component.

    Imports the python package sDNA_GH and (re)defining the MyComponent(component) 
    class.  Grasshopper instantiates this class in each such component, then 
    calls its RunScript method 
    (and recalls it on each Param update / recalculation).

    There may be multiple components, all running this same launcher code.
    Therefore we want the root logger to live in the sDNA_GH.main module
    that they each import.  The logging system is configurable by the user,
    but only through the options that are read in during the main package
    import, and we want to create logs before this too, in this module.  So 
    before a component has imported sDNA_GH.main, logging is routed through output, 
    a callable instance of Output, with a cache, defined below.  After a logger has 
    been set up according to the user's configuration, after the main package import,
    output's cache is flushed through the normal logging system, 

    Also, the Output class is used to define two Classes from this single 
    code definition.  Python scripts can happily import themselves, but here
    this is because launcher.py is itself part of the imported sDNA_GH python
    package, imported by launcher.py in a GhPython component.  To achieve this, the 
    code in this file needs to be copied into the sDNA_GH GhPython components 
    during building of the components (e.g. via the code input Param), 

    The behaviours can be different of course if changes are made to one and not
    the other. e.g. if updated code is forgotten to be copied into the component.

    A dummy MyComponent(component) class is defined in the script to appease
    GhPython's parser, even though the definition we use is imported from the package

    launcher.py can also run unit tests in a component named "selftest" 
"""

__author__ = 'James Parrott'
__version__ = '2.0'



import sys
import os
import functools
import importlib

from ghpythonlib.componentbase import executingcomponent as component
import Grasshopper
import scriptcontext as sc

import_module = importlib.import_module
try:
    reload #type: ignore
except NameError:
    reload = importlib.reload

try:
    basestring #type: ignore
except NameError:
    basestring = str

try:
    ghdoc #type: ignore
except NameError:
    from .custom.skel.basic.ghdoc import ghdoc

ZIP_FILE_NAME = 'sdna-gh'
PACKAGE_NAME = 'sDNA_GH'
PLUG_IN_NAME = 'sDNA'               
RELOAD_IF_ALREADY_IMPORTED = False
REPOSITORY = os.path.dirname(os.path.dirname(ghdoc.Path)) if ghdoc.Path else None
# Assume we are in repo_folder/dev/sDNA_build_components.gh

USER_INSTALLATION_FOLDER = os.path.join(
                                    Grasshopper.Folders.DefaultUserObjectFolder
                                   ,ZIP_FILE_NAME
                                   )
SELFTEST = 'selftest'




class Output(object): 

    def set_logger(self, logger, flush = True):
        self.logger = logger
        if flush and self.tmp_logs:
            self.flush()

    def __init__(self
                ,tmp_logs = None
                ,logger = None
                ):
        if not isinstance(tmp_logs, list): #assert not isinstance(None, list)
            tmp_logs = []
        self.tmp_logs = tmp_logs
        self.set_logger(logger, flush = False)



    def store(self, message, logging_level):
        self.tmp_logs.append( (message, logging_level) )

    def __call__(self, message, logging_level = "INFO", logging_dict = {}):
        #type: (str, str, dict, list) -> str
        
        #logger.debug(s)

        if logging_dict == {} and self.logger is not None: 
            logging_dict = dict( DEBUG = self.logger.debug
                                ,INFO = self.logger.info
                                ,WARNING = self.logger.warning
                                ,ERROR = self.logger.error
                                ,CRITICAL = self.logger.critical
                                )

        logging_level = logging_level.upper()
        if logging_level in logging_dict:
            logging_dict[logging_level](message)
        else:
            self.store(message, logging_level)

        return '%s : %s ' % (logging_level, message)

    def __getattr__(self, attr):
        return functools.partial(self.__call__, logging_level = attr.upper())

    def flush(self):
        tmp_logs = self.tmp_logs[:] # __call__ might cache back to tmp_logs
        self.tmp_logs[:] = [] # Mutate list initialised with.  Avoid double 
                              # logging in case re - stored in tmp_logs
        for tmp_log_message, tmp_log_level in tmp_logs:
            self.__call__(tmp_log_message, tmp_log_level)

output = Output()


class InvalidArgsError(Exception):
    
    """Custom exception to log the error message, and to at least allow 
       attempts to give users actionable advice to fix the issue, in 
       the event of a problem.  
    """
    message_fmt = 'Invalid import args: %s'
    def __init__(self
                ,message_fmt = ''
                ,message = ''
                ,logger = output
                , **kwargs
                ):
        if message_fmt and isinstance(message_fmt, basestring):
            self.message_fmt = message_fmt
        if kwargs and (not message or not isinstance(message, basestring)):
            message = self.message_fmt % kwargs
        logger.error(message)
        self.kwargs = kwargs
        super(InvalidArgsError, self).__init__(message)    


class ModuleNameError(InvalidArgsError):
    message_fmt = 'Invalid module name: %s'


class FilePathError(InvalidArgsError):
    message_fmt = 'Invalid path to import module from: %s'


# We only know the sDNA version to import as a string.  This is more secure too.
def strict_import(module_name = ''
                 ,folder = ''
                 ,sub_folder = ''
                 ,logger = output
                 ,reload_already_imported = RELOAD_IF_ALREADY_IMPORTED
                 ):

    # type: (str, str, str, type[any], bool) -> type[any]
    """ Imports the named module from the specified folder\subfolder only, 
        and returns it.
        
        Avoids name clashes and casual hijack attempts.  In some 
        environments supporting a Python implementation (such as 
        GhPython in Grasshopper) it may not be desirable to ask the user 
        to set PYTHONPATH.  Hence here, we save sys.path to a tmp 
        variable, set sys.path to the specified folders, attempt the 
        import in a try: block, and restore sys.path in a finally: block
    """
    if not module_name or not isinstance(module_name, basestring):
        raise ModuleNameError(module_name = module_name
                             ,folder = folder
                             ,sub_folder = sub_folder
                             ,logger = logger
                             )
    logger.debug(module_name)
    if module_name in sys.modules:   # sys.modules is also shared between GHPython components 
                                     # (and is even saved until Rhino is closed).
        logger.debug('Module %s already in sys.modules' % module_name)
        if reload_already_imported:
            logger.debug('Reloading %s.... ' % module_name)
            reload(sys.modules[module_name]) # type: ignore
        return sys.modules[module_name]
    #
    #
    # Load module_name for first time:
    #
    #
    search_path = os.path.join(folder, sub_folder)

    if (search_path 
        and isinstance(search_path, basestring) 
        and os.path.isdir(search_path)):
        #
        logger.debug('Search path == %s' % search_path)
        #if search_folder_only:
        #    sys.path = [search_path]
        if search_path not in sys.path:
            sys.path.insert(0, search_path)
    else:
        raise FilePathError(module_name = module_name
                           ,search_path = search_path
                           ,logger = logger
                           )

    logger.debug('Trying import... ')
    module = import_module(module_name, '')           

    return module       


class ModulesNotFoundError(InvalidArgsError):
    message_fmt = 'Modules not found in any location %s'


def load_modules(m_names
                ,folders
                ,logger = output
                ,module_name_error_msg = 'Please supply valid names of modules to import, %s'
                ,folders_error_msg = 'Please supply valid folders to import from. %s'
                ,modules_not_found_msg = 'Specified modules not found in any folder, %s'):
    #type(str/ Iterable, list, type[any], str, str) -> tuple / None
    """ Tries to import all modules in m_names, from the first folder in 
        folders to contain a .py or .pyc files with the same name as each 
        module.

        Returns a tuple of all the modules and the path they were found in.  Else 
        raises a ModulesNotFoundError.
    """
    if not m_names:
        raise ModuleNameError(message_fmt = 'No module names supplied, m_names = %s'
                             ,m_names = m_names
                             ,logger = logger
                             )

    if any( not isinstance(m_name, basestring) for m_name in m_names ):
        # if m_names is a basestring, the error is not raised 
        raise ModuleNameError(message_fmt = module_name_error_msg
                             ,m_names = m_names
                             ,logger = logger
                             )
    
    if isinstance(m_names, basestring):
        m_names = [m_names] 

    logger.debug('m_names == %s of type : %s' % (m_names, type(m_names).__name__))

    logger.debug('Testing paths : %s ' % folders)
    
    if isinstance(folders, basestring):
        folders = [folders]

    if not any(os.path.isdir(folder) or os.path.isdir(os.path.dirname(folder)) 
               for folder in folders
              ):
        raise FilePathError(message_fmt = folders_error_msg
                           ,m_names = m_names
                           ,logger = logger
                           )

    for folder in folders:
        logger.debug('Type(folder) : %s' % type(folder).__name__)
        logger.debug('Type(path) : %s path == %s' %(type(folder).__name__, folder))

        if os.path.isfile(folder):
            folder = os.path.dirname(folder)
        if all( any(os.path.isfile(os.path.join(folder, name.replace('.', os.sep) + ending)) 
                    for ending in ['.py','.pyc'] 
                   )
                for name in m_names
              ):
            #
            logger.debug('Importing %s' % repr(m_names))

            return tuple(strict_import(name, folder, '', logger = logger) 
                         for name in m_names
                        ) + (folder,)
            # tuple of modules, followed by the path to them
    raise ModulesNotFoundError(message_fmt = modules_not_found_msg
                              ,m_names = m_names
                              ,folders = folders
                              ,logger = logger
                              )




if __name__ == '__main__': # False in a compiled component.  But then the user
                           # can't add or remove Params to the component.  
    
    # Grasshopper will look for class MyComponent(component) in global scope
    # so a main function is a little tricky to define.

    nick_name = ghenv.Component.NickName #type: ignore


    if (REPOSITORY and 
        nick_name == 'Build_components'):
        #
        sDNA_GH_search_path = REPOSITORY 
        # builder can only load sDNA_GH from its parent directory, 
        # e.g. if in a dir one level up in the main repo
        # such as sDNA_build_components.gh.
    else:
        sDNA_GH_search_path = USER_INSTALLATION_FOLDER


    sc.doc = ghdoc #type: ignore

    output.debug(sDNA_GH_search_path)

    class sDNA_GH(object):
        pass

    if 'sDNA_GH.main' in sys.modules:
        sDNA_GH.main = sys.modules['sDNA_GH.main']
    else:
        sDNA_GH.main, _ = load_modules(m_names = PACKAGE_NAME + '.main'
                                      ,folders = sDNA_GH_search_path
                                      ,folders_error_msg = 'Please unzip %s.zip '
                                                           %ZIP_FILE_NAME
                                                           +' in the folder %s '
                                                           %Grasshopper.Folders.DefaultUserObjectFolder
                                                           +'and ensure a subfolder called %s is created '
                                                           %os.path.join(ZIP_FILE_NAME, PACKAGE_NAME)
                                                           +'inside it, containing main.py ' 
                                                           +'and all the sDNA_GH python files '
                                                           +'including those within other subfolders. ' 
                                      ,modules_not_found_msg = 'Some sDNA_GH files may be missing.  '
                                                              +'Please: 1) Copy %s.zip into: %s '
                                                              %(ZIP_FILE_NAME
                                                               ,Grasshopper.Folders.DefaultUserObjectFolder
                                                               )
                                                              +'2) Unblock it if necessary. '
                                                              +'3) Right click '
                                                              +'it, select Extract All... and click Extract, '
                                                              +'to extract it to that location. '
                                                              +'4) Ensure that main.py and all sDNA_GH python' 
                                                              +' files and subfolders are inside: %s '
                                                              %os.path.join(USER_INSTALLATION_FOLDER
                                                                           ,PACKAGE_NAME
                                                                           )
                                                              +'5) Reinitialise the component or restart Rhino.'
                                      )         


    logger = sDNA_GH.main.logger.getChild('launcher')
    output.set_logger(logger, flush = True)


    class MyComponent(component):
        pass  # Required.  Idiomatic to Grasshopper.  Must be called "MyComponent"  
            # too (it is looked for by the parser or scope checker?) otherwise 
            # Grasshopper may not find the subclass of on 
            # component.  Even though we overwrite this class on the next line
            # immediately below.  

    MyComponent = sDNA_GH.main.sDNA_GH_Component
    # Grasshopper calls MyComponent.RunScript automatically.


    if nick_name.replace(' ','').replace('_','').lower() == SELFTEST:  


        unit_tests, _ = load_modules('%s.tests.unit_tests.%s_unit_tests' % ((PACKAGE_NAME,)*2)
                                    ,sDNA_GH_search_path
                                    )

        
        MyComponent = unit_tests.make_test_running_component_class(
                                         MyComponent
                                        ,package_location = sDNA_GH_search_path
                                        )
        # Grasshopper calls MyComponent.RunScript automatically.
# ---------- end build_components ----------
build_components_2 = GhPythonScript()  # -> out; disabled
# ---------- build_components_2: Python ----------
from ghpythonlib.componentbase import executingcomponent as component
import Grasshopper, GhPython
import System
import Rhino
import rhinoscriptsyntax as rs

class MyComponent(component):
    
    def RunScript(self, x, y):
        """Provides a scripting component.
            Inputs:
                x: The x script variable
                y: The y script variable
            Output:
                a: The a output variable"""
        
        __author__ = "James"
        __version__ = "2022.07.13"
        
        import rhinoscriptsyntax as rs
        
        # return outputs if you have them; here I try it for you:
        return a
# ---------- end build_components_2 ----------
python = GhPythonScript()  # disabled
# ---------- python: Python ----------
#! /usr/bin/awk NR==3
# -*- coding: utf-8 -*-
# This module can be imported by Python but requires Grasshopper (Rhino3D) to run as a script

# MIT License

# Copyright (c) [2021] [Cardiff University, a body incorporated
# by Royal Charter and a registered charity (number:
# 1136855) whose administrative offices are at 7th floor 30-
# 36 Newport Road, UniversityCF24 0DE, Wales, UK]

# Permission is hereby granted, free of charge, to any person obtaining a copy
# of this software and associated documentation files (the "Software"), to deal
# in the Software without restriction, including without limitation the rights
# to use, copy, modify, merge, publish, distribute, sublicense, and/or sell
# copies of the Software, and to permit persons to whom the Software is
# furnished to do so, subject to the following conditions:

# The above copyright notice and this permission notice shall be included in all
# copies or substantial portions of the Software.

# THE SOFTWARE IS PROVIDED "AS IS", WITHOUT WARRANTY OF ANY KIND, EXPRESS OR
# IMPLIED, INCLUDING BUT NOT LIMITED TO THE WARRANTIES OF MERCHANTABILITY,
# FITNESS FOR A PARTICULAR PURPOSE AND NONINFRINGEMENT. IN NO EVENT SHALL THE
# AUTHORS OR COPYRIGHT HOLDERS BE LIABLE FOR ANY CLAIM, DAMAGES OR OTHER
# LIABILITY, WHETHER IN AN ACTION OF CONTRACT, TORT OR OTHERWISE, ARISING FROM,
# OUT OF OR IN CONNECTION WITH THE SOFTWARE OR THE USE OR OTHER DEALINGS IN THE
# SOFTWARE.



""" Main entry point to launch sDNA_GH if run as a script from an sDNA_GH 
GhPython component.

Imports the python package sDNA_GH and (re)defining the MyComponent(component) 
class.  Grasshopper instantiates this class in each such component, then 
calls its RunScript method 
(and recalls it on each Param update / recalculation).

There may be multiple components, all running this same launcher code.
Therefore we want the root logger to live in the sDNA_GH.main module
that they each import.  The logging system is configurable by the user,
but only through the options that are read in during the main package
import, and we want to create logs before this too, in this module.  So 
before a component has imported sDNA_GH.main, logging is routed through output, 
a callable instance of Output, with a cache, defined below.  After a logger has 
been set up according to the user's configuration, after the main package import,
output's cache is flushed through the normal logging system, 

Also, the Output class is used to define two Classes from this single 
code definition.  Python scripts can happily import themselves, but here
this is because launcher.py is itself part of the imported sDNA_GH python
package, imported by launcher.py in a GhPythoncomponent.  To achieve this, the 
code in this file needs to be copied into the sDNA_GH GhPython components 
during building of the components (e.g. via the code input Param), 

The behaviours can be different of course if changes are made to one and not
the other. e.g. if updated code is forgotten to be copied into the component.

A dummy MyComponent(component) class is defined in the script to appease
GhPython's parser, even though the definition we use is imported from the package

launcher.py can also run unittests in a component named "selftest" 
"""

__author__ = 'James Parrott'
__version__ = '0.02'



import sys
import os
import functools
import importlib


import_module = importlib.import_module
try:
    reload #type: ignore
except NameError:
    reload = importlib.reload

try:
    basestring #type: ignore
except NameError:
    basestring = str

sDNA_GH_package = 'sDNA_GH'               
reload_already_imported = False





class Output(object): 

    def set_logger(self, logger, flush = True):
        self.logger = logger
        if flush and self.tmp_logs:
            self.flush()

    def __init__(self
                ,tmp_logs = None
                ,logger = None
                ):
        if not isinstance(tmp_logs, list): #assert not isinstance(None, list)
            tmp_logs = []
        self.tmp_logs = tmp_logs
        self.set_logger(logger, flush = False)



    def store(self, message, logging_level):
        self.tmp_logs.append( (message, logging_level) )

    def __call__(self, message, logging_level = "INFO", logging_dict = {}):
        #type: (str, str, dict, list) -> str
        
        #logger.debug(s)

        if logging_dict == {} and self.logger is not None: 
            logging_dict = dict( DEBUG = self.logger.debug
                                ,INFO = self.logger.info
                                ,WARNING = self.logger.warning
                                ,ERROR = self.logger.error
                                ,CRITICAL = self.logger.critical
                                )

        logging_level = logging_level.upper()
        if logging_level in logging_dict:
            logging_dict[logging_level](message)
        else:
            self.store(message, logging_level)

        return '%s : %s ' % (logging_level, message)

    def __getattr__(self, attr):
        return functools.partial(self.__call__, logging_level = attr.upper())

    def flush(self):
        tmp_logs = self.tmp_logs[:] # __call__ might cache back to tmp_logs
        self.tmp_logs[:] = [] # Mutate list initialised with.  Avoid double 
                              # logging in case re - stored in tmp_logs
        for tmp_log_message, tmp_log_level in tmp_logs:
            self.__call__(tmp_log_message, tmp_log_level)

output = Output()


class InvalidArgsError(Exception):
    
    """Custom exception to log the error message, and to at least allow 
       attempts to give users actionable advice to fix the issue, in 
       the event of a problem.  
    """
    message_fmt = 'Invalid import args: %s'
    def __init__(self
                ,message_fmt = ''
                ,message = ''
                ,logger = output
                , **kwargs
                ):
        if message_fmt and isinstance(message_fmt, basestring):
            self.message_fmt = message_fmt
        if not message or not isinstance(message, basestring):
            message = self.message_fmt % kwargs
        logger.error(message)
        self.kwargs = kwargs
        super(Exception, self).__init__(message)    


class ModuleNameError(InvalidArgsError):
    message_fmt = 'Invalid module name: %s'


class FilePathError(InvalidArgsError):
    message_fmt = 'Invalid path to import module from: %s'


# We only know the sDNA version to import as a string.  This is more secure too.
def strict_import(module_name = ''
                 ,folder = ''
                 ,sub_folder = ''
                 ,logger = output
                 ,reload_already_imported = reload_already_imported
                 ):

    # type: (str, str, str, type[any], bool) -> type[any]
    """ Imports the named module from the specified folder\subfolder only, 
        and returns it.
        
        Avoids name clashes and casual hijack attempts.  In some 
        environments supporting a Python implementation (such as 
        GhPython in Grasshopper) it may not be desireable to ask the user 
        to set PYTHONPATH.  Hence here, we save sys.path to a tmp 
        variable, set sys.path to the specified folders, attempt the 
        import in a try: block, and restore sys.path in a finally: block
    """
    if not module_name or not isinstance(module_name, basestring):
        raise ModuleNameError(module_name = module_name
                             ,folder = folder
                             ,sub_folder = sub_folder
                             ,logger = logger
                             )
    logger.debug(module_name)
    if module_name in sys.modules:   # sys.modules is also shared between GHPython components 
                                     # (and is even saved until Rhino is closed).
        logger.debug('Module %s already in sys.modules' % module_name)
        if reload_already_imported:
            logger.debug('Reloading %s.... ' % module_name)
            reload(sys.modules[module_name]) # type: ignore
        return sys.modules[module_name]
    #
    #
    # Load module_name for first time:
    #
    #
    search_path = os.path.join(folder, sub_folder)

    if (search_path 
        and isinstance(search_path, basestring) 
        and os.path.isdir(search_path)):
        #
        logger.debug('Search path == %s' % search_path)
        #if search_folder_only:
        #    sys.path = [search_path]
        if search_path not in sys.path:
            sys.path.insert(0, search_path)
    else:
        raise FilePathError(module_name = module_name
                           ,search_path = search_path
                           ,logger = logger
                           )

    logger.debug('Trying import... ')
    module = import_module(module_name, '')           

    return module       


class ModulesNotFoundError(InvalidArgsError):
    message_fmt = 'Modules not found in any location %s'


def load_modules(m_names
                ,folders
                ,logger = output
                ,module_name_error_msg = 'Please supply valid names of modules to import, %s'
                ,folders_error_msg = 'Please supply valid folders to import from. %s'
                ,modules_not_found_msg = 'Specified modules not found in any folder, %s'):
    #type(str/ Iterable, list, type[any], str, str) -> tuple / None
    """ Tries to import all modules in m_names, from the first folder in 
        folders to contain a .py or .pyc files with the same name as each 
        module.

        Returns a tuple of all the modules and the path they were found in.  Else 
        raises a ModulesNotFoundError.
    """
    if not m_names or any( not isinstance(m_name, basestring) 
                               for m_name in m_names ):
        raise ModuleNameError(message_fmt = module_name_error_msg
                             ,m_names = m_names
                             ,logger = logger
                             )
    
    if isinstance(m_names, basestring):
        m_names = [m_names] 
    logger.debug('m_names == %s of type : %s' % (m_names, type(m_names).__name__))

    logger.debug('Testing paths : %s ' % folders)
    
    if isinstance(folders, basestring):
        folders = [folders]

    if not any(os.path.isdir(folder) or os.path.isdir(os.path.dirname(folder)) 
               for folder in folders
              ):
        raise FilePathError(message_fmt = folders_error_msg
                           ,m_names = m_names
                           ,logger = logger
                           )

    for folder in folders:
        logger.debug('Type(folder) : %s' % type(folder).__name__)
        logger.debug('Type(path) : %s path == %s' %(type(folder).__name__, folder))

        if os.path.isfile(folder):
            folder = os.path.dirname(folder)
        if all( any(os.path.isfile(os.path.join(folder, name.replace('.', os.sep) + ending)) 
                    for ending in ['.py','.pyc'] 
                   )
                for name in m_names
              ):
            #
            logger.debug('Importing %s' % repr(m_names))

            return tuple(strict_import(name, folder, '', logger = logger) 
                            for name in m_names
                        ) + (folder,)
            # tuple of modules, followed by the path to them
    raise ModulesNotFoundError(message_fmt = modules_not_found_msg
                              ,m_names = m_names
                              ,folders = folders
                              ,logger = logger
                              )



if __name__ == '__main__': # False in a compiled component.  But then the user
                           # can't add or remove Params to the component.  
    
    # Grasshopper will look for class MyComponent(component) in global scope
    # so a main function is a little tricky to define.

    from ghpythonlib.componentbase import executingcomponent as component
    import Grasshopper
    import scriptcontext as sc
    # The Grasshopper API imports are done here separately to
    # let the above functions be imported outside the GhPython
    # e.g. for testing


    sDNA_GH_search_paths = [ Grasshopper.Folders.DefaultUserObjectFolder ]

    nick_name = ghenv.Component.NickName #type: ignore


    sc.doc = ghdoc #type: ignore

    output.debug(sDNA_GH_search_paths)

    class sDNA_GH(object):
        pass

    error_message = 1
    sDNA_GH.main, _ = load_modules(m_names = sDNA_GH_package + '.main'
                                  ,folders = sDNA_GH_search_paths
                                  ,folders_error_msg = 'Please ensure a folder called %s' % sDNA_GH_package 
                                                        +' is created in '
                                                        +Grasshopper.Folders.DefaultUserObjectFolder                                                                    
                                                        +', containing main.py and all sDNA_GH python' 
                                                        +' files and subfolders. ' 
                                  ,modules_not_found_msg = 'Some sDNA_GH files may be missing.  Please copy'
                                                          +' sDNA_GH.zip into: '
                                                          +Grasshopper.Folders.DefaultUserObjectFolder
                                                          +', Unblock it if necessary, and then right click'
                                                          +' it and select Extract All... in that location. '
                                                          +' Ensure that main.py and all sDNA_GH python' 
                                                          +' files and subfolders are inside: '
                                                          +os.path.join(Grasshopper.Folders.DefaultUserObjectFolder
                                                                       ,sDNA_GH_package
                                                                       )
                                   )         


    logger = sDNA_GH.main.logger.getChild('launcher')
    output.set_logger(logger, flush = True)


    class MyComponent(component):
        pass  # Required.  Idiomatic to Grasshopper.  Must be called "MyComponent"  
            # too (it is looked for by the parser or scope checker?) otherwise 
            # Grasshopper may not find the subclass of on 
            # component.  Even though we overwrite this class on the next line
            # immediately below.  

    MyComponent = sDNA_GH.main.sDNA_GH_Component


    if nick_name.replace(' ','').replace('_','').lower() == 'selftest':  

        if sys.argv[0].endswith(os.path.join(sDNA_GH_package,'__main__.py')):   
            from .tests.unit_tests import unit_tests_sDNA_GH
        else:
            unit_tests_sDNA_GH, _ = load_modules('sDNA_GH.tests.unit_tests.unit_tests_sDNA_GH'
                                                ,sDNA_GH_search_paths
                                                )

        MyComponent._RunScript = MyComponent.RunScript
        MyComponent.RunScript = unit_tests_sDNA_GH.run_launcher_tests
# ---------- end python ----------
show_auto_options = GhPythonScript()  # -> out, a
# ---------- show_auto_options: Python ----------
__author__ = "James"
__version__ = "2022.06.21"

import rhinoscriptsyntax as rs

if x:
    options = x['options']
    print('\n'.join('%s == %s' % (attr, getattr(options, attr) )
                    for attr in options._fields
                    if attr.startswith('auto')
                    )
         )
    metas = x['metas']
    print('\n'.join('%s == %s' % (attr, getattr(metas, attr) )
                    for attr in metas._fields
                    if attr in ['show_all']
                    )
         )
# ---------- end show_auto_options ----------
unload_sdna = Unload_sDNA()  # -> out, a
# ---------- unload_sdna: Python ----------
#! /usr/bin/awk NR==3
# -*- coding: utf-8 -*-
# This module requires Grasshopper Python (Rhino3D)

# MIT License

# Copyright (c) [2021] [Cardiff University, a body incorporated
# by Royal Charter and a registered charity (number:
# 1136855) whose administrative offices are at 7th floor 30-
# 36 Newport Road, UniversityCF24 0DE, Wales, UK]

# Permission is hereby granted, free of charge, to any person obtaining a copy
# of this software and associated documentation files (the "Software"), to deal
# in the Software without restriction, including without limitation the rights
# to use, copy, modify, merge, publish, distribute, sublicense, and/or sell
# copies of the Software, and to permit persons to whom the Software is
# furnished to do so, subject to the following conditions:

# The above copyright notice and this permission notice shall be included in all
# copies or substantial portions of the Software.

# THE SOFTWARE IS PROVIDED "AS IS", WITHOUT WARRANTY OF ANY KIND, EXPRESS OR
# IMPLIED, INCLUDING BUT NOT LIMITED TO THE WARRANTIES OF MERCHANTABILITY,
# FITNESS FOR A PARTICULAR PURPOSE AND NONINFRINGEMENT. IN NO EVENT SHALL THE
# AUTHORS OR COPYRIGHT HOLDERS BE LIABLE FOR ANY CLAIM, DAMAGES OR OTHER
# LIABILITY, WHETHER IN AN ACTION OF CONTRACT, TORT OR OTHERWISE, ARISING FROM,
# OUT OF OR IN CONNECTION WITH THE SOFTWARE OR THE USE OR OTHER DEALINGS IN THE
# SOFTWARE.

""" Unload the sDNA_GH Python package and all sDNA modules, by removing them from GhPython's shared cache (sys.modules).  The 
    next sDNA_GH component to run will then reload the package and installation-wide options file (config.toml), and any specified 
    options including a project specific config.toml, without otherwise having to restart Rhino to clear its cache.
"""

__author__ = 'James Parrott'
__version__ = '1.0'


from ghpythonlib.componentbase import executingcomponent as component

class MyComponent(component):
    
    def RunScript(self, unload, update):
        import sys  #Imported here to avoid weird bug 
                    # (unloading/forgetting of sys - IronPython only?)
        #https://discourse.mcneel.com/t/failed-import-of-sys-library-in-ghpython/98696


        print('sDNA_GH packages and modules in sys.modules:')
        print('\n'.join([key for key in sys.modules if 'sdna' in key.lower()]))
        def is_imported(s):
            return s in sys.modules
        if unload is True:
            if 'logging' in sys.modules:
                sys.modules['logging'].shutdown()
            shared_cached_modules_etc = sys.modules.copy().keys()
            for y in shared_cached_modules_etc:
                if 'sdna' in y.lower():
                    del sys.modules[y]
        
        
                
        print('sDNA_GH imported == %s' % is_imported('sDNA_GH'))
        print('sDNA_GH.tools imported == %s' % is_imported('sDNA_GH.tools'))
        print('sDNAUISpec imported == %s' % is_imported('sDNAUISpec'))
        print('runsdnacommand == %s' % is_imported('runsdnacommand'))

        
        return
# ---------- end unload_sdna ----------
config = GhPythonScript()  # disabled; same code as python
delete_sdna_gh = Button()
panel_2 = Panel(build_components.out)
update = Button()
self_test = GhPythonScript()  # -> out; disabled; same code as python
unload_sdna_2 = Unload_sDNA(unload=delete_sdna_gh, update=update)  # -> out, a
# ---------- unload_sdna_2: Python ----------
#! /usr/bin/awk NR==3
# -*- coding: utf-8 -*-
# This module requires Grasshopper Python (Rhino3D)

# MIT License

# Copyright (c) [2021] [Cardiff University, a body incorporated
# by Royal Charter and a registered charity (number:
# 1136855) whose administrative offices are at 7th floor 30-
# 36 Newport Road, UniversityCF24 0DE, Wales, UK]

# Permission is hereby granted, free of charge, to any person obtaining a copy
# of this software and associated documentation files (the "Software"), to deal
# in the Software without restriction, including without limitation the rights
# to use, copy, modify, merge, publish, distribute, sublicense, and/or sell
# copies of the Software, and to permit persons to whom the Software is
# furnished to do so, subject to the following conditions:

# The above copyright notice and this permission notice shall be included in all
# copies or substantial portions of the Software.

# THE SOFTWARE IS PROVIDED "AS IS", WITHOUT WARRANTY OF ANY KIND, EXPRESS OR
# IMPLIED, INCLUDING BUT NOT LIMITED TO THE WARRANTIES OF MERCHANTABILITY,
# FITNESS FOR A PARTICULAR PURPOSE AND NONINFRINGEMENT. IN NO EVENT SHALL THE
# AUTHORS OR COPYRIGHT HOLDERS BE LIABLE FOR ANY CLAIM, DAMAGES OR OTHER
# LIABILITY, WHETHER IN AN ACTION OF CONTRACT, TORT OR OTHERWISE, ARISING FROM,
# OUT OF OR IN CONNECTION WITH THE SOFTWARE OR THE USE OR OTHER DEALINGS IN THE
# SOFTWARE.

""" Unload the sDNA_GH Python package and all sDNA modules, by removing them from GhPython's shared cache (sys.modules).  The 
    next sDNA_GH component to run will then reload the package and installation-wide options file (config.toml), and any specified 
    options including a project specific config.toml, without otherwise having to restart Rhino to clear its cache.
"""

__author__ = 'James Parrott'
__version__ = '2.0'


from ghpythonlib.componentbase import executingcomponent as component

class MyComponent(component):
    
    def RunScript(self, unload, update):
        import sys  #Imported here to avoid weird bug 
                    # (unloading/forgetting of sys - IronPython only?)
        #https://discourse.mcneel.com/t/failed-import-of-sys-library-in-ghpython/98696


        print('sDNA_GH packages and modules in sys.modules:')
        print('\n'.join([key for key in sys.modules if 'sdna' in key.lower()]))
        def is_imported(s):
            return s in sys.modules
        if unload is True:
            if 'logging' in sys.modules:
                sys.modules['logging'].shutdown()
            shared_cached_modules_etc = sys.modules.copy().keys()
            for y in shared_cached_modules_etc:
                if 'sdna' in y.lower():
                    del sys.modules[y]
        
        
                
        print('sDNA_GH imported == %s' % is_imported('sDNA_GH'))
        print('sDNA_GH.tools imported == %s' % is_imported('sDNA_GH.tools'))
        print('sDNAUISpec imported == %s' % is_imported('sDNAUISpec'))
        print('runsdnacommand == %s' % is_imported('runsdnacommand'))

        
        return
# ---------- end unload_sdna_2 ----------
panel_3 = Panel(unload_sdna_2.out)
readme_getter = GhPythonScript()  # -> out, a
# ---------- readme_getter: Python ----------
import os

from ghpythonlib.componentbase import executingcomponent as component
import Grasshopper, GhPython
import System
import Rhino
import rhinoscriptsyntax as rs

def text_file_to_str(file, extra_new_line_char = '', encoding = 'utf-8'):
    #type(str, str) -> str
    """ A simple text file reader.  """
    if file is None or not isinstance(file, basestring):
        msg = 'file == %s is not a string' % file
        logger.error(msg)
        raise TypeError(msg)
    elif not os.path.isfile(file):
        msg = 'file == %s is not a file path' % file
        logger.error(msg)
        raise ValueError(msg)
    else:
        with open(file, 'rb') as f:
            file_contents = extra_new_line_char.join(line.decode(encoding)
                                                     for line in f
                                                    )
    return file_contents

class MyComponent(component):
    
    def RunScript(self, x, y):
        
        sDNA_GH_path = os.path.dirname(ghdoc.Path)
        
        README_md_path = os.path.join(sDNA_GH_path, 'README.md')
        if not os.path.isfile(README_md_path):
            README_md_path = os.path.join(os.path.dirname(sDNA_GH_path), 'README.md')
        # Readme.md is a level higher in the repo than in the sDNA_GH
        # folder in a user installation - it is moved intentionally
        # by create_release_sDNA_GH_zip.bat 
        readme = text_file_to_str(README_md_path)
        a = 'anything'
        
        doc = self.Attributes.Owner.OnPingDocument()
        readme_component = next(component 
                                for component in doc.Objects
                                if component.NickName == 'Readme.txt'
                               ) 
        
        readme_component.SetUserText(readme)
        
        return a
# ---------- end readme_getter ----------
readme_txt = Panel("""# sDNA_GH
sDNA is a world leading tool for Spatial Design Network Analysis.  sDNA_GH is a plug-in for Grasshopper providing components that run the tools from a local [sDNA](https://github.com/fiftysevendegreesofrad/sdna_open/releases) installation, on Rhino and Grasshopper geometry and data.  

## sDNA
sDNA is able to calculate Betweenness, Closeness, Angular distance, and many other quantities including custom hybrid metrics, and is able to perform many other advanced functions as well.  Please note, for results of a network analysis to be meaningful, it must be ensured that the network is first properly [prepared](https://sdna-open.readthedocs.io/en/latest/network_preparation.html).

## sDNA_GH functionality
sDNA_GH: 
 - Reads a network's polyline Geometry from Rhino or Grasshopper, and Data from any User Text on it. 
 - Writes the network polylines (formed by one or more polylines) and user Data to a Shapefile.  
 - Initiates an sDNA tool that processes that shapefile, and e.g. carries out a network preparation or an analysis.
 - Reads the shapefile produced by the sDNA tool.
 - Displays the results from sDNA by colouring a new layer of new polylines or the original ones.

## User manual.  
__version__ = '2.2.0'

## Table of contents

- [sDNA_GH](#sdna_gh)
  - [sDNA](#sdna)
  - [sDNA_GH functionality](#sdna_gh-functionality)
  - [User manual.](#user-manual)
    - [System Requirements.](#system-requirements)
      - [Software](#software)
      - [Hardware](#hardware)
    - [Installation.](#installation)
    - [Usage.](#usage)
      - [Components.](#components)
        - [Automatic multi-tools.](#automatic-multi-tools)
        - [Running individual tools.](#running-individual-tools)
        - [Component Execution Order.](#component-execution-order)
      - [Options.](#options)
        - [Adding Component Input and Output Params.](#adding-component-input-and-output-params)
        - [Logging options](#logging-options)
        - [Local meta options.](#local-meta-options)
        - [Shared state vs desynchronised components.](#shared-state-vs-desynchronised-components)
      - [Tools.](#tools)
        - [Common component input and output Params](#common-component-input-and-output-params)
        - [Support tools](#support-tools)
        - [Shapefile tools](#shapefile-tools)
        - [Plotting tools](#plotting-tools)
        - [User Text tools](#user-text-tools)
        - [Data tools](#data-tools)
      - [sDNA Tools](#sdna-tools)
        - [Analysis tools](#analysis-tools)
        - [Preparation tools](#preparation-tools)
        - [Geometric analysis tools](#geometric-analysis-tools)
        - [Calibration tools](#calibration-tools)
        - [Dev tool(s)](#dev-tools)
    - [Example Grasshopper definitions.](#example-grasshopper-definitions)
      - [Running sDNA Integral on a random grid read from Rhino.](#running-sdna-integral-on-a-random-grid-read-from-rhino)
        - [Selecting and specifying an sDNA Results field.](#selecting-and-specifying-an-sdna-results-field)
        - [Reading shapefile data with existing geometry.](#reading-shapefile-data-with-existing-geometry)
        - [Using a Grasshopper Colour gradient component.](#using-a-grasshopper-colour-gradient-component)
        - [Adding a legend with a Legend component.](#adding-a-legend-with-a-legend-component)
        - [Customising legend class boundaries and tag names.](#customising-legend-class-boundaries-and-tag-names)
      - [Running sDNA Integral on a random grid of Grasshopper geometry (colouring with the Custom Preview component).](#running-sdna-integral-on-a-random-grid-of-grasshopper-geometry-colouring-with-the-custom-preview-component)
      - [Running sDNA Integral on a network of polylines, approximating a network of arcs from intersecting circles.](#running-sdna-integral-on-a-network-of-polylines-approximating-a-network-of-arcs-from-intersecting-circles)
        - [Recolouring the arcs instead of polylines.](#recolouring-the-arcs-instead-of-polylines)
      - [Writing polylines and data to shapefiles.](#writing-polylines-and-data-to-shapefiles)
      - [Reading in polylines and data from shapefiles.](#reading-in-polylines-and-data-from-shapefiles)
      - [Writing User Text.](#writing-user-text)
      - [Reading User Text for sDNA (e.g. User weights).](#reading-user-text-for-sdna-eg-user-weights)
      - [Baking (saving Grasshopper objects to a Rhino document) with User Text. -->](#baking-saving-grasshopper-objects-to-a-rhino-document-with-user-text---)
    - [License.](#license)
    - [Copyright.](#copyright)
  - [Contact.](#contact)
  - [Developer manual.](#developer-manual)
    - [Dependencies.](#dependencies)
      - [](#)
    - [Build instructions.](#build-instructions)
      - [To build new sDNA components.](#to-build-new-sdna-components)
    - [Misc](#misc)


### System Requirements. 
#### Software
1. Windows 10 or 8.1 (not tested in Windows 11) 
2. Python 2.7.  Please note Iron Python 2.7 does not run sDNA correctly (as incorrect shapefiles are produced).
3. sDNA. 
4. Rhino and Grasshopper (tested in Rhino 7)
#### Hardware
1. 64-bit Intel or AMD processor (Not ARM) 
2. No more than 63 CPU Cores. 
3. 8 GB memory (RAM) or more is recommended. 
4. 1.2 GB disk space. 

### Installation.
1. Ensure you have an installation of [Rhino 3D](https://www.rhino3d.com/download/) including Grasshopper (versions 6 and 7 are supported).
2. Ensure you have an installation of [Python 2.7](http://www.python.org/ftp/python/2.7.3/python-2.7.3.msi) [^0] or [Python 2.7.18](https://www.python.org/downloads/release/python-2718/)  that can run sDNA correctly from the command line, with pip for sDNA Learn.  sDNA_GH runs sDNA from the command line.  Command line use of sDNA has been tested with Python versions 2.6 and 2.7 .  Do not run sDNA with Iron Python 2.7, as invalid shape files may be produced (it is not possible to access the Iron Python shipped with Rhino from the command line, in any case).  
3. sDNA Learn requires numpy.  Numpy can be added after installing Python 2.7.18 by opening a `cmd` window and typing: `cd C:\Python27\Scripts` and `pip2.7 install numpy`
4. To use sDNA with sDNA_GH, ensure you have an installation of [sDNA](https://sdna-open.readthedocs.io/en/latest/installation_usage.html).  sDNA itself may require the 64 bit (x64) Visual Studio 2008 redistributable, available [here](https://docs.microsoft.com/en-us/cpp/windows/latest-supported-vc-redist?view=msvc-170#visual-studio-2008-vc-90-sp1-no-longer-supported) or [here](https://download.microsoft.com/download/5/D/8/5D8C65CB-C849-4025-8E95-C3966CAFD8AE/vcredist_x64.exe ) ).  The closed source "free as in beer" version of [sDNA](https://sdna.cardiff.ac.uk/sdna/software/software/) and sDNA+ may also require the 32 bit (x86) Visual Studio 2008 redistributable available or [here](https://docs.microsoft.com/en-us/cpp/windows/latest-supported-vc-redist?view=msvc-170#visual-studio-2008-vc-90-sp1-no-longer-supported) or [here](https://download.microsoft.com/download/5/D/8/5D8C65CB-C849-4025-8E95-C3966CAFD8AE/vcredist_x86.exe) in order to unlock sDNA with a serial number.
5. Download `sdna-gh.zip` from (food4rhino)[https://www.food4rhino.com/en/app/sdnagh] or the [sDNA_GH releases page on Github](https://github.com/JamesParrott/sDNA_GH/releases).
6. Ensure `sdna-gh.zip` is unblocked: Open File Explorer and go to your Downloads folder (or whichever folder you saved it in).  Right click it and select `Properties` from the bottom of the menu.  Then click on the _Unblock_ check box at the bottom (right of _Security_), then click `OK` or `Apply`.  The check box and _Security_ section should disappear.  This should unblock all the files in the zip archive.  Please do not automatically trust and unblock all software downloaded from anywhere on the internet [^1].  
7. Open Rhino and Grasshopper.
8. In Grasshopper's pull down menus (above the tabs ribbon at the top) click `File` -> `Special folders` -> `User Objects Folder`.  The default in Rhino 7 is `%appdata%\Grasshopper\UserObjects`.  Note, this is not the Components Folder used by many other plug-ins (i.e. not `%appdata%\Grasshopper\Libraries`).
9. Copy `sdna-gh.zip` to this folder (e.g. it should be at `%appdata%\Grasshopper\UserObjects\sdna-gh.zip`).
10. Unzip `sdna-gh.zip` to this location (in Windows 10 right click `sdna-gh.zip` and select `Extract All ...`, then click `Extract` to use the suggested location).  In the User Objects folder, a new folder called `sdna-gh` should have been created, itself containing a subfolder called `sDNA_GH` (plus license.md and copies of these readme files).

11. Restart Rhino and Grasshopper.
12. The sDNA_GH plug in components should now be available under a new "sDNA" tab in the ribbon amongst the tabs for any other plug-ins installed (right of `Mesh`, `Intersect`, `Transform` and `Display` etc).  
13. To use sDNA with sDNA_GH, if no preferences are specified, sDNA_GH will search for sDNA and Python 2.7 installations automatically, using the first one of each it finds.  To ensure sDNA_GH uses a particular version of sDNA and the correct Python 2.7 interpreter it is recommended on first usage to:
    -place a Config component on the canvas (the component with a gear/cog icon in `Extra`).
    -Specify the file path of the sDNA folder (containing sDNAUISpec.py and runsdnacommand.py) of the sDNA installation you wish to use in the `sDNA_folders` input.
    -Specify the file path of the Python 2.7 interpreter's main executable in the `python` input.
    -Specify any other options you wish to save and reuse on all projects, if necessary by adding custom input Params with the option's name.
    -Connect a true boolean toggle to `go`.  An installation wide user options file (`config.toml`) will be created if there isn't one already.
    -To save options to other project specific `config.toml` files, specify the file path in `save_to` and repeat the previous 4 sub steps.

14. If a newer version of sDNA is used in future with tools unknown to sDNA_GH at the time it was built, if a Config component is placed, and the path of the new sDNA specified in `sDNA_folders`, sDNA_GH will attempt to automatically build components and user objects for the new sDNA tools, and add them to Grasshopper for you.  Set `make_new_comps` to false to prevent this.


### Usage.  
#### Components.

##### Automatic multi-tools.
Each sDNA tool has its own Grasshopper component.  To run a tool, a true value, e.g. from a Boolean toggle component, must be connected to its component's `go` Input Param [^note].  To group together common work flows, if an `auto_` option is set to true, some components also automatically run other tools before and after they run their own tools (if components for those tools are not connected to it).  For example, this allows an entire sDNA process to be run on Rhino Geometry from a single sDNA tool component.  
When an sDNA_GH component is first placed on the canvas, or a grasshopper file with an sDNA_GH component on the canvas is first loaded, each component adds in Params for all its required Input and Output arguments (if the Params are not already present).  These added Params include those of any extra automatically added tools if an `auto_` option is true, that would other wise require separate components.  Extra customisation can be carried out by adding in user specified Params too, that have the correct name of a supported option.  Similarly any Params not being specified can be removed.  

[note] The Config component tool always loads its options when placed or its Inputs are updated for any value of `go`.  On the Unload_sDNA component, `unload` does the same thing as `go`.

##### Running individual tools.  
Multiple sDNA_GH components can be chained together to run in sequence by connecting the `OK` Output Param of one component, to the `go` Input Param of the component(s) to be run afterwards.  A Grasshopper Colour Gradient tool can be connected in between a Parse_Data component and Recolour_Objects component.  

##### Component Execution Order.
Multiple sDNA_GH tools can be run from a single sDNA_GH component by setting any of the `auto_` options to true: `auto_get_Geom`, `auto_read_User_Text`, `auto_write_Shp`, `auto_read_Shp` and `auto_plot_data`, on a Config component, before placing the chosen sDNA_GH tool on the canvas (as long as components for those tools are not connected to it).    
**Warning!**   If you did not create a `config.toml` file (in Installation step 13 above), and if you rely instead on Config components inside your .gh file itself to set option values, immediately before saving your .gh file, be sure to select the Config component determining any `auto_` options, and press `Ctrl` + `B` (or from the pull-down menu select `Edit` -> `Arrange` -> `Put To Back`) to to send to the back, any components that should run first when you reload the .gh file.  This ensures the Config component will run before other sDNA_GH components, which rely on settings controlled by it to configure themselves correctly.

#### Options.  
sDNA_GH is highly customisable.  This customisation is controlled by setting options.  To give an option a value, connect a Grasshopper Param or text panel containing that value, to the Param with that option name on any sDNA_GH component (except Unload_sDNA).  If a Param is subsequently disconnected, its latest value will be remembered.  Some Text Params can be cleared by connecting an empty Text Panel to them.
Any option in a component can be read by adding an Output Param and renaming it to the name of the option.  Options whose names are all in capitals are read only.  Any other option in a component can be changed by adding an Input Param and renaming it to the name of the option, and connecting it to the new value.  Entire options data structures (`opts`) may also be passed in from other sDNA_GH components as well, via normal Grasshopper connections. 

##### Adding Component Input and Output Params.  
To add a new Input or Output Param, zoom in on the component until plus and minus symbols can be seen between the params.  Click on the plus symbol where you want the new Param.  Right click the new Param's name (e.g. x, y or z for an Input Param, or a,b or c for an Output Param) to rename it to name of the desired option you wish to set.

##### Logging options
If `log_file` is not an empty string, a log file is created before Input Params are created on components, so to have any effect, the options `propagate`, `working_folder`, `logs_dir` and `log_file` must be set in an installation wide config.toml file, e.g. by setting those options and `go` to true on Config component, and restarting Rhino.  Logging levels can be changed dynamically.  Supported values for `log_file_level` and `log_console_level` are: `DEBUG`, `INFO`, `WARNING`, `ERROR` and `CRITICAL`.  To suppress output from the `out` Output param entirely, set `log_console_level` to `CRITICAL`.  To propagate log messages higher than the sDNA_GH package's parent
logger (which will most likely result in a lot of output), set `propagate` to true.
 
###### Options override priority order
1. The component input Param options override options in a project specific options file (`config`).  
2. A project specific options file (specified in `config`) overrides options from another sDNA_GH component (connected in `opts`).  
3. Options from another sDNA_GH component override the installation-wide options file (e.g. `%appdata%\Grasshopper\UserObjects\sdna-gh\sDNA_GH\config.toml`).  
4. On start up only (and every time thereafter if `sync = false`, `no_state = true` and `read_only = false`) the installation-wide options file overrides the sDNA_GH hard-coded default options in `main.py` [^note]
[note] Dev note: the options in `main.py` themselves override every individual tool's default options in `tools.py`.

##### Local meta options.
By default all sDNA_GH components, across all Grasshopper canvases in the same Rhino process, share (and may change) the same global `opts` (module options, tool options, and *meta* options) in the `main.py` module.  If only one of each tool is needed (and there is only one version of sDNA), that will suffice for most users. 

To give an sDNA_GH component different options to another of the same type using the shared global options, it must de-synchronise from the global options.  De-syncing occurs if a component's *local meta option* `sync` is false (if `read_only` is true, it will still read from but not update the global options).  *local metas* are like any other option, except a) they are shared using `l_metas` instead of `opts`, and b) they are not updated automatically from the global module options (as this would defeat their entire purpose).

Components referring to the global options share their settings.  This means they do not know if a particular setting in the global
options came from a different component sharing with it, or from itself previously.  Shared states mean even a component in isolation has its own historical state.  To use components without any options sharing and a minimum of state, set `sync` to false and `no_state` to true (its default). 

##### Shared state vs desynchronised components.
sDNA_GH has two fundamentally different modes of operation controlled by the Boolean `sync` local meta option:  synchronised and desynchronised.  Local meta options of components can only be changed directly on each component via user Params, by project options files (`config` params) or by the installation wide options file (`config.toml`).  By default, components are desynchronised (`sync` = false).  A few useful features are available from synchronised components, but they may behave in unexpected ways, and may even feel buggy and glitchy.  It is recommended to undertake a one off setup process to save your commonly used custom options in an installation wide options file (`config.toml`).  This is necessary to run sDNA if sDNA_GH fails to automatically find sDNA or the Python 2.7 run time; even if this is successful but takes a while, it is still a good idea.  Thereafter all components can be used as desynchronised: 
 -on first usage set all common and shared options and those that will seldom be changed on synchronised components, and save these to an installation wide `config.toml` file.  Desynchronised 
 options may still read defaults from an installation wide `config.toml` file.
 -Either set the synchronised components to `sync` = false after their shared options have been saved, or place new components.

To set all components to synchronised, set `sync` = true on a Config component, leave `save_to` unconnected, and set `go` = true.
This writes `sync` = true to the installation wide options file (`config.toml`).  As long as no higher priority options source (Params, project specific options files, or local metas from other components) sets `sync` = false, all desynchronised components will then resynchronise the next time they run.

To desynchronise all synchronised components, set `sync` = false on a Config component, leave `save_to` unconnected, and set `go` = true.  This writes `sync` = false to the sDNA_GH `config.toml`.  Finally, one of three alternatives is necessary to make these changes take effect, as synchronised components only read the installation wide options file on start up:
a) Restart Rhino, 
b) Set `unload = true` on an Unload_sDNA component, set `unload = false` on it immediately afterwards, then manually re-initialise each component (double click its name or icon to see its source code and click OK, or delete it and replace it from the sDNA_GH ribbon).
c) Set the `config` on each component to be resynchronised to the file path of the installation wide options file (e.g.  `%appdata%\Grasshopper\UserObjects\sdna-gh\sDNA_GH\config.toml` - expand `%appdata%` in a File Explorer).

###### Desynchronised components (`sync` = false):
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""")
